test file "TestHarness"

suite "MotorPi"

  case "Check PI bounds" [simulation]
    model testMotorPi
    input "inData.mat", mapped to MotorRpm (active)
    assessment "Assessment1": At any point of time, MotorSetpoint must be greater than or equal to 0 and less than or equal to 1
      MotorSetpoint: signal testMotorPi/Subsystem Reference, port 1

suite "System"

  case "Test controller performance" [simulation]
    model MotorControl
    assessment "Assessment1": At any point of time, if t == 40 becomes true then, with no delay, MotorRpm >= 1900 must stay true for at least 5
    assessment "Assessment2": At any point of time, if t == 40 becomes true then, with no delay, MotorRpm <= 2100 must stay true for at least 5
      MotorRpm: signal MotorControl/Controller/RadSToRpm, port 1